# Grasshopper definition test_minimal.gh (Grasshopper 1.0.8)

curves = Curve()
area = Area(Geometry=curves)  # -> Area, Centroid; disabled
deconstruct = Deconstruct(Point=area.Centroid)  # -> XComponent, YComponent, ZComponent; disabled
number_slider = Slider(2, range=0..10)  # disabled
construct_point = ConstructPoint(XCoordinate=deconstruct.XComponent, YCoordinate=deconstruct.YComponent, ZCoordinate=0)  # disabled
point_groups = PointGroups(Points=construct_point, Distance=number_slider)  # -> Groups, Indices; disabled
list_item = ListItem(Index=point_groups.Indices, Wrap=True)  # disabled
list_item_2 = ListItem(List=deconstruct.ZComponent, Index=point_groups.Indices, Wrap=True)  # disabled
sort_list = SortList(Keys=list_item_2, ValuesValuesA=list_item)  # -> Keys, simplify(ValuesValuesA); disabled
curve = Curve(sort_list.ValuesValuesA)  # disabled
explode_tree = ExplodeTree(Data=curve)  # -> Branch0, Branch1, Branch2, Branch3; disabled
curve_2 = Curve(explode_tree.Branch0)  # disabled
curve_3 = Curve(explode_tree.Branch1)  # disabled
curve_4 = Curve(explode_tree.Branch2)  # disabled
curve_5 = Curve(explode_tree.Branch3)  # disabled
loft = Loft(Curves=curve_2, Options={Adjust=False, Closed=False, LoftEnds=0, LoftSimp=0, LoftType=0, Rebuild=10, Refit=0.01})  # disabled
loft_2 = Loft(Curves=curve_3, Options={Adjust=False, Closed=False, LoftEnds=0, LoftSimp=0, LoftType=0, Rebuild=10, Refit=0.01})  # disabled
loft_3 = Loft(Curves=curve_4, Options={Adjust=False, Closed=False, LoftEnds=0, LoftSimp=0, LoftType=0, Rebuild=10, Refit=0.01})  # disabled
loft_4 = Loft(Curves=curve_5, Options={Adjust=False, Closed=False, LoftEnds=0, LoftSimp=0, LoftType=0, Rebuild=10, Refit=0.01})  # disabled
cap_holes = CapHoles(Brep=loft)  # disabled
cap_holes_2 = CapHoles(Brep=loft_2)  # disabled
cap_holes_3 = CapHoles(Brep=loft_3)  # disabled
cap_holes_4 = CapHoles(Brep=loft_4)  # disabled
mesh_brep = MeshBrep(
    Brep=cap_holes,
    Settings={GridMaxCount=0, GridMinCount=16, JaggedSeams=False, MaxEdgeLength=0, MinEdgeLength=0.0001, MinTolerance=0, Refine=True, RefineAngle=0, RelativeTolerance=0.65, SimplePlanes=True, Tolerance=0})  # disabled
mesh_brep_2 = MeshBrep(
    Brep=cap_holes_2,
    Settings={GridMaxCount=0, GridMinCount=16, JaggedSeams=False, MaxEdgeLength=0, MinEdgeLength=0.0001, MinTolerance=0, Refine=True, RefineAngle=0, RelativeTolerance=0.65, SimplePlanes=True, Tolerance=0})  # disabled
mesh_brep_3 = MeshBrep(
    Brep=cap_holes_3,
    Settings={GridMaxCount=0, GridMinCount=16, JaggedSeams=False, MaxEdgeLength=0, MinEdgeLength=0.0001, MinTolerance=0, Refine=True, RefineAngle=0, RelativeTolerance=0.65, SimplePlanes=True, Tolerance=0})  # disabled
mesh_brep_4 = MeshBrep(
    Brep=cap_holes_4,
    Settings={GridMaxCount=0, GridMinCount=16, JaggedSeams=False, MaxEdgeLength=0, MinEdgeLength=0.0001, MinTolerance=0, Refine=True, RefineAngle=0, RelativeTolerance=0.65, SimplePlanes=True, Tolerance=0})  # disabled
merge = Merge(Data1=mesh_brep, Data2=mesh_brep_2, Data3=mesh_brep_3, Data4=mesh_brep_4)  # disabled
mesh = Mesh(flatten(merge))  # disabled
panel = Panel(mesh)  # disabled

graft_tree = GraftTree(Tree=curves, IncludeEmptyLists=True, IncludeNullItems=True)
pipe = Pipe(Curve=graft_tree, Radius=Slider(0.5, range=0..1), Caps=0, FitRail=False)
mesh_brep_5 = MeshBrep(
    Brep=pipe,
    Settings={GridMaxCount=0, GridMinCount=16, JaggedSeams=False, MaxEdgeLength=0, MinEdgeLength=0.0001, MinTolerance=0, Refine=True, RefineAngle=0, RelativeTolerance=0.65, SimplePlanes=True, Tolerance=0})
mesh_2 = Mesh(mesh_brep_5)
mesh_3 = Geometry(flatten(mesh_2))
